% Simulink data dictionary sogi_parameters.sldd

Meas_SOGI_In_PU_f32 = Simulink.Signal(DataType="single", Unit="1")  % Normalized input/output in PU, dimensionless; README S1-S2.
Meas_SOGI_Rst_u8 = Simulink.Signal(DataType="uint8", Min=0, Max=255, Unit="1")  % Reset command: any nonzero value zeros effective states and outputs.
Meas_SOGI_FED_PU_f32 = Simulink.Signal(DataType="single", Unit="1")  % In-phase band-pass output, PU; D(j*w0)=1; README S1.
Meas_SOGI_FEQ_PU_f32 = Simulink.Signal(DataType="single", Unit="1")  % Quadrature output, PU; Q(j*w0)=-j and Q(0)=k; README S1.
Meas_SOGI_FEX1_PU_f32 = Simulink.Signal(DataType="single", Unit="1")  % Effective reset-masked state; zero on first reset sample. FE/ZOH: present physical state x[k].
Meas_SOGI_FEX2_PU_f32 = Simulink.Signal(DataType="single", Unit="1")  % Effective reset-masked state; zero on first reset sample. FE/ZOH: present physical state x[k].
Meas_SOGI_BED_PU_f32 = Simulink.Signal(DataType="single", Unit="1")  % In-phase band-pass output, PU; D(j*w0)=1; README S1.
Meas_SOGI_BEQ_PU_f32 = Simulink.Signal(DataType="single", Unit="1")  % Quadrature output, PU; Q(j*w0)=-j and Q(0)=k; README S1.
Meas_SOGI_BEX1_PU_f32 = Simulink.Signal(DataType="single", Unit="1")  % Effective reset-masked state; zero on first reset sample. BE: previous physical output x[k-1].
Meas_SOGI_BEX2_PU_f32 = Simulink.Signal(DataType="single", Unit="1")  % Effective reset-masked state; zero on first reset sample. BE: previous physical output x[k-1].
Meas_SOGI_TustinD_PU_f32 = Simulink.Signal(DataType="single", Unit="1")  % In-phase band-pass output, PU; D(j*w0)=1; README S1.
Meas_SOGI_TustinQ_PU_f32 = Simulink.Signal(DataType="single", Unit="1")  % Quadrature output, PU; Q(j*w0)=-j and Q(0)=k; README S1.
Meas_SOGI_TustinX1_PU_f32 = Simulink.Signal(DataType="single", Unit="1")  % Effective reset-masked state; zero on first reset sample. Tustin: auxiliary xi=(I+h*A/2)*x_prev+h*B*u_prev/2; same PU dimension.
Meas_SOGI_TustinX2_PU_f32 = Simulink.Signal(DataType="single", Unit="1")  % Effective reset-masked state; zero on first reset sample. Tustin: auxiliary xi=(I+h*A/2)*x_prev+h*B*u_prev/2; same PU dimension.
Meas_SOGI_ZOHD_PU_f32 = Simulink.Signal(DataType="single", Unit="1")  % In-phase band-pass output, PU; D(j*w0)=1; README S1.
Meas_SOGI_ZOHQ_PU_f32 = Simulink.Signal(DataType="single", Unit="1")  % Quadrature output, PU; Q(j*w0)=-j and Q(0)=k; README S1.
Meas_SOGI_ZOHX1_PU_f32 = Simulink.Signal(DataType="single", Unit="1")  % Effective reset-masked state; zero on first reset sample. FE/ZOH: present physical state x[k].
Meas_SOGI_ZOHX2_PU_f32 = Simulink.Signal(DataType="single", Unit="1")  % Effective reset-masked state; zero on first reset sample. FE/ZOH: present physical state x[k].
Cal_SOGI_F0_Hz_f32 = Simulink.Parameter(single(50), Min=0, Unit="Hz")  % SOGI offline snapshot; README S1-S2. Regenerate coefficients together; no online tuning.
Cal_SOGI_Ts_s_f32 = Simulink.Parameter(single(5.0e-5), Min=0, Unit="s")  % SOGI offline snapshot; README S1-S2. Regenerate coefficients together; no online tuning.
Cal_SOGI_K_f32 = Simulink.Parameter(single(1.41421354), Min=0, Unit="1")  % SOGI offline snapshot; README S1-S2. Regenerate coefficients together; no online tuning.
Cal_SOGI_FEA11_f32 = Simulink.Parameter(single(0.977785587), Unit="1")  % Derived FE discrete A(1,1), dimensionless. xi_next=Ad*xi+Bd*u; y=Cd*xi+Dd*u. Source: README FE derivation; sogi_coefficients. No independent tuning; regenerate coherent snapshot.
Cal_SOGI_FEA12_f32 = Simulink.Parameter(single(-0.0157079622), Unit="1")  % Derived FE discrete A(1,2), dimensionless. xi_next=Ad*xi+Bd*u; y=Cd*xi+Dd*u. Source: README FE derivation; sogi_coefficients. No independent tuning; regenerate coherent snapshot.
Cal_SOGI_FEA21_f32 = Simulink.Parameter(single(0.0157079622), Unit="1")  % Derived FE discrete A(2,1), dimensionless. xi_next=Ad*xi+Bd*u; y=Cd*xi+Dd*u. Source: README FE derivation; sogi_coefficients. No independent tuning; regenerate coherent snapshot.
Cal_SOGI_FEA22_f32 = Simulink.Parameter(single(1), Unit="1")  % Derived FE discrete A(2,2), dimensionless. xi_next=Ad*xi+Bd*u; y=Cd*xi+Dd*u. Source: README FE derivation; sogi_coefficients. No independent tuning; regenerate coherent snapshot.
Cal_SOGI_FEB11_f32 = Simulink.Parameter(single(0.0222144146), Unit="1")  % Derived FE discrete B(1,1), dimensionless. xi_next=Ad*xi+Bd*u; y=Cd*xi+Dd*u. Source: README FE derivation; sogi_coefficients. No independent tuning; regenerate coherent snapshot.
Cal_SOGI_FEB21_f32 = Simulink.Parameter(single(0), Unit="1")  % Derived FE discrete B(2,1), dimensionless. xi_next=Ad*xi+Bd*u; y=Cd*xi+Dd*u. Source: README FE derivation; sogi_coefficients. No independent tuning; regenerate coherent snapshot.
Cal_SOGI_FEC11_f32 = Simulink.Parameter(single(1), Unit="1")  % Derived FE discrete C(1,1), dimensionless. xi_next=Ad*xi+Bd*u; y=Cd*xi+Dd*u. Source: README FE derivation; sogi_coefficients. No independent tuning; regenerate coherent snapshot.
Cal_SOGI_FEC12_f32 = Simulink.Parameter(single(0), Unit="1")  % Derived FE discrete C(1,2), dimensionless. xi_next=Ad*xi+Bd*u; y=Cd*xi+Dd*u. Source: README FE derivation; sogi_coefficients. No independent tuning; regenerate coherent snapshot.
Cal_SOGI_FEC21_f32 = Simulink.Parameter(single(0), Unit="1")  % Derived FE discrete C(2,1), dimensionless. xi_next=Ad*xi+Bd*u; y=Cd*xi+Dd*u. Source: README FE derivation; sogi_coefficients. No independent tuning; regenerate coherent snapshot.
Cal_SOGI_FEC22_f32 = Simulink.Parameter(single(1), Unit="1")  % Derived FE discrete C(2,2), dimensionless. xi_next=Ad*xi+Bd*u; y=Cd*xi+Dd*u. Source: README FE derivation; sogi_coefficients. No independent tuning; regenerate coherent snapshot.
Cal_SOGI_FED11_f32 = Simulink.Parameter(single(0), Unit="1")  % Derived FE discrete D(1,1), dimensionless. xi_next=Ad*xi+Bd*u; y=Cd*xi+Dd*u. Source: README FE derivation; sogi_coefficients. No independent tuning; regenerate coherent snapshot.
Cal_SOGI_FED21_f32 = Simulink.Parameter(single(0), Unit="1")  % Derived FE discrete D(2,1), dimensionless. xi_next=Ad*xi+Bd*u; y=Cd*xi+Dd*u. Source: README FE derivation; sogi_coefficients. No independent tuning; regenerate coherent snapshot.
Cal_SOGI_BEA11_f32 = Simulink.Parameter(single(0.978032291), Unit="1")  % Derived BE discrete A(1,1), dimensionless. xi_next=Ad*xi+Bd*u; y=Cd*xi+Dd*u. Source: README BE derivation; sogi_coefficients. No independent tuning; regenerate coherent snapshot.
Cal_SOGI_BEA12_f32 = Simulink.Parameter(single(-0.0153628942), Unit="1")  % Derived BE discrete A(1,2), dimensionless. xi_next=Ad*xi+Bd*u; y=Cd*xi+Dd*u. Source: README BE derivation; sogi_coefficients. No independent tuning; regenerate coherent snapshot.
Cal_SOGI_BEA21_f32 = Simulink.Parameter(single(0.0153628942), Unit="1")  % Derived BE discrete A(2,1), dimensionless. xi_next=Ad*xi+Bd*u; y=Cd*xi+Dd*u. Source: README BE derivation; sogi_coefficients. No independent tuning; regenerate coherent snapshot.
Cal_SOGI_BEA22_f32 = Simulink.Parameter(single(0.999758661), Unit="1")  % Derived BE discrete A(2,2), dimensionless. xi_next=Ad*xi+Bd*u; y=Cd*xi+Dd*u. Source: README BE derivation; sogi_coefficients. No independent tuning; regenerate coherent snapshot.
Cal_SOGI_BEB11_f32 = Simulink.Parameter(single(0.0217264127), Unit="1")  % Derived BE discrete B(1,1), dimensionless. xi_next=Ad*xi+Bd*u; y=Cd*xi+Dd*u. Source: README BE derivation; sogi_coefficients. No independent tuning; regenerate coherent snapshot.
Cal_SOGI_BEB21_f32 = Simulink.Parameter(single(0.000341277686), Unit="1")  % Derived BE discrete B(2,1), dimensionless. xi_next=Ad*xi+Bd*u; y=Cd*xi+Dd*u. Source: README BE derivation; sogi_coefficients. No independent tuning; regenerate coherent snapshot.
Cal_SOGI_BEC11_f32 = Simulink.Parameter(single(0.978032291), Unit="1")  % Derived BE discrete C(1,1), dimensionless. xi_next=Ad*xi+Bd*u; y=Cd*xi+Dd*u. Source: README BE derivation; sogi_coefficients. No independent tuning; regenerate coherent snapshot.
Cal_SOGI_BEC12_f32 = Simulink.Parameter(single(-0.0153628942), Unit="1")  % Derived BE discrete C(1,2), dimensionless. xi_next=Ad*xi+Bd*u; y=Cd*xi+Dd*u. Source: README BE derivation; sogi_coefficients. No independent tuning; regenerate coherent snapshot.
Cal_SOGI_BEC21_f32 = Simulink.Parameter(single(0.0153628942), Unit="1")  % Derived BE discrete C(2,1), dimensionless. xi_next=Ad*xi+Bd*u; y=Cd*xi+Dd*u. Source: README BE derivation; sogi_coefficients. No independent tuning; regenerate coherent snapshot.
Cal_SOGI_BEC22_f32 = Simulink.Parameter(single(0.999758661), Unit="1")  % Derived BE discrete C(2,2), dimensionless. xi_next=Ad*xi+Bd*u; y=Cd*xi+Dd*u. Source: README BE derivation; sogi_coefficients. No independent tuning; regenerate coherent snapshot.
Cal_SOGI_BED11_f32 = Simulink.Parameter(single(0.0217264127), Unit="1")  % Derived BE discrete D(1,1), dimensionless. xi_next=Ad*xi+Bd*u; y=Cd*xi+Dd*u. Source: README BE derivation; sogi_coefficients. No independent tuning; regenerate coherent snapshot.
Cal_SOGI_BED21_f32 = Simulink.Parameter(single(0.000341277686), Unit="1")  % Derived BE discrete D(2,1), dimensionless. xi_next=Ad*xi+Bd*u; y=Cd*xi+Dd*u. Source: README BE derivation; sogi_coefficients. No independent tuning; regenerate coherent snapshot.
Cal_SOGI_TustinA11_f32 = Simulink.Parameter(single(0.977908969), Unit="1")  % Derived Tustin discrete A(1,1), dimensionless. xi_next=Ad*xi+Bd*u; y=Cd*xi+Dd*u. Source: README Tustin derivation; sogi_coefficients. No independent tuning; regenerate coherent snapshot.
Cal_SOGI_TustinA12_f32 = Simulink.Parameter(single(-0.0155344605), Unit="1")  % Derived Tustin discrete A(1,2), dimensionless. xi_next=Ad*xi+Bd*u; y=Cd*xi+Dd*u. Source: README Tustin derivation; sogi_coefficients. No independent tuning; regenerate coherent snapshot.
Cal_SOGI_TustinA21_f32 = Simulink.Parameter(single(0.0155344605), Unit="1")  % Derived Tustin discrete A(2,1), dimensionless. xi_next=Ad*xi+Bd*u; y=Cd*xi+Dd*u. Source: README Tustin derivation; sogi_coefficients. No independent tuning; regenerate coherent snapshot.
Cal_SOGI_TustinA22_f32 = Simulink.Parameter(single(0.999878), Unit="1")  % Derived Tustin discrete A(2,2), dimensionless. xi_next=Ad*xi+Bd*u; y=Cd*xi+Dd*u. Source: README Tustin derivation; sogi_coefficients. No independent tuning; regenerate coherent snapshot.
Cal_SOGI_TustinB11_f32 = Simulink.Parameter(single(0.0219690446), Unit="1")  % Derived Tustin discrete B(1,1), dimensionless. xi_next=Ad*xi+Bd*u; y=Cd*xi+Dd*u. Source: README Tustin derivation; sogi_coefficients. No independent tuning; regenerate coherent snapshot.
Cal_SOGI_TustinB21_f32 = Simulink.Parameter(single(0.00017254446), Unit="1")  % Derived Tustin discrete B(2,1), dimensionless. xi_next=Ad*xi+Bd*u; y=Cd*xi+Dd*u. Source: README Tustin derivation; sogi_coefficients. No independent tuning; regenerate coherent snapshot.
Cal_SOGI_TustinC11_f32 = Simulink.Parameter(single(0.988954484), Unit="1")  % Derived Tustin discrete C(1,1), dimensionless. xi_next=Ad*xi+Bd*u; y=Cd*xi+Dd*u. Source: README Tustin derivation; sogi_coefficients. No independent tuning; regenerate coherent snapshot.
Cal_SOGI_TustinC12_f32 = Simulink.Parameter(single(-0.00776723027), Unit="1")  % Derived Tustin discrete C(1,2), dimensionless. xi_next=Ad*xi+Bd*u; y=Cd*xi+Dd*u. Source: README Tustin derivation; sogi_coefficients. No independent tuning; regenerate coherent snapshot.
Cal_SOGI_TustinC21_f32 = Simulink.Parameter(single(0.00776723027), Unit="1")  % Derived Tustin discrete C(2,1), dimensionless. xi_next=Ad*xi+Bd*u; y=Cd*xi+Dd*u. Source: README Tustin derivation; sogi_coefficients. No independent tuning; regenerate coherent snapshot.
Cal_SOGI_TustinC22_f32 = Simulink.Parameter(single(0.999939), Unit="1")  % Derived Tustin discrete C(2,2), dimensionless. xi_next=Ad*xi+Bd*u; y=Cd*xi+Dd*u. Source: README Tustin derivation; sogi_coefficients. No independent tuning; regenerate coherent snapshot.
Cal_SOGI_TustinD11_f32 = Simulink.Parameter(single(0.0109845223), Unit="1")  % Derived Tustin discrete D(1,1), dimensionless. xi_next=Ad*xi+Bd*u; y=Cd*xi+Dd*u. Source: README Tustin derivation; sogi_coefficients. No independent tuning; regenerate coherent snapshot.
Cal_SOGI_TustinD21_f32 = Simulink.Parameter(single(8.627223e-5), Unit="1")  % Derived Tustin discrete D(2,1), dimensionless. xi_next=Ad*xi+Bd*u; y=Cd*xi+Dd*u. Source: README Tustin derivation; sogi_coefficients. No independent tuning; regenerate coherent snapshot.
Cal_SOGI_ZOHA11_f32 = Simulink.Parameter(single(0.977908969), Unit="1")  % Derived ZOH discrete A(1,1), dimensionless. xi_next=Ad*xi+Bd*u; y=Cd*xi+Dd*u. Source: README ZOH derivation; sogi_coefficients. No independent tuning; regenerate coherent snapshot.
Cal_SOGI_ZOHA12_f32 = Simulink.Parameter(single(-0.0155341374), Unit="1")  % Derived ZOH discrete A(1,2), dimensionless. xi_next=Ad*xi+Bd*u; y=Cd*xi+Dd*u. Source: README ZOH derivation; sogi_coefficients. No independent tuning; regenerate coherent snapshot.
Cal_SOGI_ZOHA21_f32 = Simulink.Parameter(single(0.0155341374), Unit="1")  % Derived ZOH discrete A(2,1), dimensionless. xi_next=Ad*xi+Bd*u; y=Cd*xi+Dd*u. Source: README ZOH derivation; sogi_coefficients. No independent tuning; regenerate coherent snapshot.
Cal_SOGI_ZOHA22_f32 = Simulink.Parameter(single(0.999877512), Unit="1")  % Derived ZOH discrete A(2,2), dimensionless. xi_next=Ad*xi+Bd*u; y=Cd*xi+Dd*u. Source: README ZOH derivation; sogi_coefficients. No independent tuning; regenerate coherent snapshot.
Cal_SOGI_ZOHB11_f32 = Simulink.Parameter(single(0.0219685864), Unit="1")  % Derived ZOH discrete B(1,1), dimensionless. xi_next=Ad*xi+Bd*u; y=Cd*xi+Dd*u. Source: README ZOH derivation; sogi_coefficients. No independent tuning; regenerate coherent snapshot.
Cal_SOGI_ZOHB21_f32 = Simulink.Parameter(single(0.000173183245), Unit="1")  % Derived ZOH discrete B(2,1), dimensionless. xi_next=Ad*xi+Bd*u; y=Cd*xi+Dd*u. Source: README ZOH derivation; sogi_coefficients. No independent tuning; regenerate coherent snapshot.
Cal_SOGI_ZOHC11_f32 = Simulink.Parameter(single(1), Unit="1")  % Derived ZOH discrete C(1,1), dimensionless. xi_next=Ad*xi+Bd*u; y=Cd*xi+Dd*u. Source: README ZOH derivation; sogi_coefficients. No independent tuning; regenerate coherent snapshot.
Cal_SOGI_ZOHC12_f32 = Simulink.Parameter(single(0), Unit="1")  % Derived ZOH discrete C(1,2), dimensionless. xi_next=Ad*xi+Bd*u; y=Cd*xi+Dd*u. Source: README ZOH derivation; sogi_coefficients. No independent tuning; regenerate coherent snapshot.
Cal_SOGI_ZOHC21_f32 = Simulink.Parameter(single(0), Unit="1")  % Derived ZOH discrete C(2,1), dimensionless. xi_next=Ad*xi+Bd*u; y=Cd*xi+Dd*u. Source: README ZOH derivation; sogi_coefficients. No independent tuning; regenerate coherent snapshot.
Cal_SOGI_ZOHC22_f32 = Simulink.Parameter(single(1), Unit="1")  % Derived ZOH discrete C(2,2), dimensionless. xi_next=Ad*xi+Bd*u; y=Cd*xi+Dd*u. Source: README ZOH derivation; sogi_coefficients. No independent tuning; regenerate coherent snapshot.
Cal_SOGI_ZOHD11_f32 = Simulink.Parameter(single(0), Unit="1")  % Derived ZOH discrete D(1,1), dimensionless. xi_next=Ad*xi+Bd*u; y=Cd*xi+Dd*u. Source: README ZOH derivation; sogi_coefficients. No independent tuning; regenerate coherent snapshot.
Cal_SOGI_ZOHD21_f32 = Simulink.Parameter(single(0), Unit="1")  % Derived ZOH discrete D(2,1), dimensionless. xi_next=Ad*xi+Bd*u; y=Cd*xi+Dd*u. Source: README ZOH derivation; sogi_coefficients. No independent tuning; regenerate coherent snapshot.