% Simulink data dictionary sogi_state_space_parameters.sldd

Cal_SOGI_F0_Hz_f32 = Simulink.Parameter(single(50), Unit="Hz")  % External baseline only. Actual physical parameter is supplied at the formal model input; frozen for each run. Validate range, poles and scheduling before use.
Cal_SOGI_K_f32 = Simulink.Parameter(single(1.41421354), Unit="1")  % External baseline only. Actual physical parameter is supplied at the formal model input; frozen for each run. Validate range, poles and scheduling before use.
Cal_SOGI_Ts_s_f32 = Simulink.Parameter(single(5.0e-5), Unit="s")  % External baseline only. Actual physical parameter is supplied at the formal model input; frozen for each run. Validate range, poles and scheduling before use.
Meas_SOGI_FED_PU_f32 = Simulink.Signal(DataType="single")  % SOGI FE physical state/output in PU. Scalar; inherited discrete rate. Zero initial state and reset-priority output. No arbitrary saturation; finite-input test domain is specified in the interface contract.
Meas_SOGI_FEQ_PU_f32 = Simulink.Signal(DataType="single")  % SOGI FE physical state/output in PU. Scalar; inherited discrete rate. Zero initial state and reset-priority output. No arbitrary saturation; finite-input test domain is specified in the interface contract.
State_SOGI_FED_PU_f32 = Simulink.Signal(DataType="single")  % SOGI FE physical state/output in PU. Scalar; inherited discrete rate. Zero initial state and reset-priority output. No arbitrary saturation; finite-input test domain is specified in the interface contract.
State_SOGI_FEQ_PU_f32 = Simulink.Signal(DataType="single")  % SOGI FE physical state/output in PU. Scalar; inherited discrete rate. Zero initial state and reset-priority output. No arbitrary saturation; finite-input test domain is specified in the interface contract.